# Grasshopper definition AnalyseBrep_1.gh (Grasshopper 1.0.7)
# plug-ins: ViewDeformations, SurfaceSlider, StressDirectionSlider, PartitionSlider, PointsToBrep, MDSKGrasshopper, SetUniBC, ViewStresses, PreDef, LoadSlider, SetUniLoad, MeshTBrep, FEMeshTBrep, DeformationSlider, ClosestPoint

pt = Point([<point referenced from the Rhino model> x8])
brep = Brep(<brep referenced from the Rhino model>)
load_and_bc_toggle = BooleanToggle(False)
toggle = BooleanToggle(False)
scale_def_curve = Curve(<curve referenced from the Rhino model>)
p2b = PointsToBrep(Points=pt)
# MESHING
mesh_curves = Curve([<curve referenced from the Rhino model> x3])
# LOAD AND BC
bc_curve = Curve(<curve referenced from the Rhino model>)
load_curve = Curve(<curve referenced from the Rhino model>)
len = Length(Curve=load_curve)
surfslider = SurfaceSlider(SliderVR=load_curve, Brep=p2b)  # -> Surface, Text, Size, Plane, Colors, Geometry
surfslider_2 = SurfaceSlider(SliderVR=bc_curve, Brep=p2b)  # -> Surface, Text, Size, Plane, Colors, Geometry
divslider = DivisionSlider(SliderVR=mesh_curves, Brep=p2b)  # -> MeshDivisionU, MeshDivisionV, MeshDivisionW, Text, Size, Plane, Colors, Geometry
debrep = DeconstructBrep(Brep=p2b)  # -> Faces, Edges, Vertices
mdsk_geometry = MDSK(Geometry=surfslider.Geometry, Color=surfslider.Colors, Start=load_and_bc_toggle)
crv = Curve(<curve referenced from the Rhino model>)
item = ListItem(List=debrep.Vertices, Index=Slider(4, range=0..6), Wrap=True)
panel = Panel(divslider.MeshDivisionW)
mdsk_geometry_2 = MDSK(Geometry=surfslider_2.Geometry, Color=surfslider_2.Colors, Start=load_and_bc_toggle)
mdsk_geometry_3 = MDSK(Color=RGB(255, 255, 255), Start=toggle)
panel_2 = Panel(item)
loadslider = LoadSlider(SliderVR=crv, Brep=p2b)  # -> Load, Text, Size, Plane, Colors, Geometry
uniloads = UniformLoadComponentForFEA(
    Surface=surfslider.Surface,
    LoadVector=loadslider.Load,
    UCount=divslider.MeshDivisionU,
    VCount=divslider.MeshDivisionV,
    WCount=divslider.MeshDivisionW,
    Brep=p2b)  # -> PointLoads, LoadArrows, ArrowColoring
unibc = UniformBCComponentForFEA(
    Surface=surfslider_2.Surface,
    UCount=divslider.MeshDivisionU,
    VCount=divslider.MeshDivisionV,
    WCount=divslider.MeshDivisionW,
    Brep=p2b)  # -> BCPoints, BCCones, ColoringForBCCones
mdsk_geometry_4 = MDSK(Color=loadslider.Colors, Start=load_and_bc_toggle)
mdsk_geometry_5 = MDSK(Geometry=uniloads.LoadArrows, Color=uniloads.ArrowColoring, Start=load_and_bc_toggle)
mdsk_geometry_6 = MDSK(Geometry=unibc.BCCones, Color=unibc.ColoringForBCCones, Start=load_and_bc_toggle)
vec = VectorXYZ(XComponent=0, YComponent=0, ZComponent=0)  # -> Vector, Length

# ---- group: Prescrived def
item_2 = ListItem(List=debrep.Vertices, Index=Slider(0, range=0..10), Wrap=True)
predef = PreDef(Points=item_2, PrescribedDeformations=vec.Vector)

# ----
meshtbrep = MeshTBrep(TBrep=p2b, UCount=divslider.MeshDivisionU, VCount=divslider.MeshDivisionV, WCount=divslider.MeshDivisionW)  # -> Connectivity, Nodes
defslider = DeformationSlider(SliderVR=scale_def_curve)  # -> Scale, Text, Size, Plane, Colors, Geometry
brep_2 = Brep()
closest_point = FindTheClosestPointToSphere(Sphere=brep_2, Connectivity=meshtbrep.Connectivity, Nodes=meshtbrep.Nodes)  # -> Point, Text, Plane, Colors
mdsk_geometry_7 = MDSK(Color=RGB(255, 255, 255), Start=toggle)
femeshtbrep = FiniteElementOfMeshedTBrep(
    Connectivity=meshtbrep.Connectivity,
    Nodes=meshtbrep.Nodes,
    BoundaryConditions=unibc.BCPoints,
    PointLoads=uniloads.PointLoads,
    PreDeformations=predef,
    Brep=p2b)  # -> Displacement, Strain, Stress, Nodes, Text, Size, Plane, ColorT

# ---- group: StressDirSlider
crv_2 = Curve(<curve referenced from the Rhino model>)

# ----
stressslider = StressDirectionSlider(SliderVR=crv_2)  # -> StressDirection, Text, Size, Plane, Color, Geometry
mdsk_geometry_8 = MDSK(Color=RGB(255, 255, 255), Start=toggle)
# STRESS PREVIEW
viewstress = ViewStresses(
    Connectivity=meshtbrep.Connectivity,
    PointsForBreps=meshtbrep.Nodes,
    Stresses=femeshtbrep.Stress,
    StressDirection=stressslider.StressDirection,
    Displacement=femeshtbrep.Displacement,
    Scaling=defslider.Scale,
    Brep=p2b)  # -> Solid, Color_solid, Legend, Color_legend, Text, Size, Plane, Color_T
# DEFORMATION PREVIEW
# DEFORMATION PREVIEW
# DEFORMATION PREVIEW
viewdef = ViewDeformations(
    Connectivity=meshtbrep.Connectivity,
    PointsForBreps=meshtbrep.Nodes,
    Displacement=femeshtbrep.Displacement,
    Scaling=defslider.Scale,
    Brep=p2b)  # -> BrepSolid, ColorSolid, BrepOuterEdges, ColorEdges, Text, Size, Plane, ColorT
tag = TextTag3D(Location=viewstress.Plane, Text=viewstress.Text, Size=1, Justification=7)
panel_3 = Panel(viewstress.Plane)
mdsk_geometry_9 = MDSK(Geometry=viewdef.BrepOuterEdges, Color=viewdef.ColorEdges, Start=toggle)
mdsk_geometry_10 = MDSK(Geometry=viewstress.Legend, Color=viewstress.Color_legend, Start=toggle)
mdsk_geometry_11 = MDSK(Geometry=viewdef.BrepSolid, Color=viewdef.ColorSolid, Start=toggle)
mdsk_geometry_12 = MDSK(Geometry=viewstress.Solid, Color=viewstress.Color_solid, Start=toggle)
panel_4 = Panel(viewdef.Plane)
